# Grasshopper definition GetRaster.gh (Grasshopper 1.0.7)
# plug-ins: TwinLand Info

esri_raster = ValueList({"ESRI World Imagery": "https://server.arcgisonline.com/ArcGIS/rest/services/World_Imagery/MapServer/export?", "ESRI World Topo Map": "https://server.arcgisonline.com/arcgis/rest/services/World_Topo_Map/MapServer/export?", "ESRI World Physical Map": "https://server.arcgisonline.com/arcgis/rest/services/World_Physical_Map/MapServer/export?", "ESRI World Street Map": "https://server.arcgisonline.com/arcgis/rest/services/World_Street_Map/MapServer/export?", "ESRI World Terrain Base": "https://server.arcgisonline.com/arcgis/rest/services/World_Terrain_Base/MapServer/export?", "ESRI World Shaded Relief": "https://server.arcgisonline.com/arcgis/rest/services/World_Shaded_Relief/MapServer/export?", "ESRI World Dark Gray Base": "https://server.arcgisonline.com/arcgis/rest/services/Canvas/World_Dark_Gray_Base/MapServer/export?", "ESRI World Light Gray Base": "https://server.arcgisonline.com/arcgis/rest/services/Canvas/World_Light_Gray_Base/MapServer/export?", "ESRI World Hillshade": "https://server.arcgisonline.com/arcgis/rest/services/Elevation/World_Hillshade/MapServer/export?", "ESRI World Hillshade Dark": "https://server.arcgisonline.com/arcgis/rest/services/Elevation/World_Hillshade_Dark/MapServer/export?", "ESRI World Boundaries and Places": "https://server.arcgisonline.com/arcgis/rest/services/Reference/World_Boundaries_and_Places/MapServer/export?", "ESRI World Transportation": "https://server.arcgisonline.com/arcgis/rest/services/Reference/World_Transportation/MapServer/export?", "ESRI DeLorme World Base Map": "https://server.arcgisonline.com/arcgis/rest/services/Specialty/DeLorme_World_Base_Map/MapServer/export?", "ESRI NatGeo World Map": "https://server.arcgisonline.com/arcgis/rest/services/NatGeo_World_Map/MapServer/export?", "ESRI USA Topo Maps": "https://server.arcgisonline.com/arcgis/rest/services/USA_Topo_Maps/MapServer/export?"}, selected="ESRI World Imagery")
getraster = GetRaster(
    Boundary=<geometry referenced from the Rhino model>,
    Resolution=1024,
    TargetFolder="/Users/jiaqizheng/Desktop/temp",
    Prefix="testRaster",
    RESTURL=esri_raster,
    Run=Toggle(True),
    UserSpatialReferenceSystem="WGS84",
    ImageType="jpg")  # -> Image, ImageFrame, RESTQuery
